# Grasshopper definition S20.gh (Grasshopper 1.0.7)

s20_and_master_curve_cluster = S20AndMasterCurveCluster()  # -> geo, reparameterize(master_curve_smooth_2), puncture_curves_on_polysurface_2, map_curves_on_polysurface_2, offset_curves_almost_on_polysurface_2
construct_domain = ConstructDomain(DomainStart=0, DomainEnd=1)
integer = Integer(8)
range = Range(Domain=construct_domain, Steps=integer)
curve = Curve(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)
evaluate_curve = EvaluateCurve(Curve=reparameterize(curve), Parameter=range)  # -> Point, Tangent, Angle
# Project offset curves onto polysurface
sort_map_curves = GhPythonScript(
    mapCurves=s20_and_master_curve_cluster.map_curves_on_polysurface_2,
    offsetMapCurves=s20_and_master_curve_cluster.offset_curves_almost_on_polysurface_2)  # -> out, mapCurveDict; unedited script template
python = GhPythonScript(
    Run=Toggle(True),
    file="FlipperToGH_v2.py",
    initial_curve="f",
    mapping_class="aBeFcdAE",
    iterations=Slider(2, range=0..5))  # -> out, data
# ---------- python: Python ----------
__author__ = "will"
__version__ = "2021.03.16"

import rhinoscriptsyntax as rs
import subprocess
triangulation = [(~1,~8,~0),(~7,3,8),(~2,~6,7),(~5,2,6),(~3,~4,5),(0,1,4)]

import os

if ghdoc.Path:
    direc = os.path.dirname(ghdoc.Path)

    
Path = direc + "\\" + file

iterations = str(int(iterations))

args = [str(initial_curve), str(mapping_class), iterations]
if Run:
    
    comm = subprocess.Popen(['C:\Python39\python.exe', Path] + args, stdout=subprocess.PIPE, stderr=subprocess.STDOUT)
    stdout = comm.communicate()
    
    stdout=stdout[0]
    
    if stdout[:9] == 'Traceback':
        print stdout
    else:
        data=eval(stdout)
    

    comm.stdout.close()
    comm.wait()
# ---------- end python ----------
python_2 = GhPythonScript(Run=Toggle(True), file="FlipperToGH.py", curve="[1,0,1,0,1,1,0,1,1]")  # -> out, data
# ---------- python_2: Python ----------
__author__ = "will"
__version__ = "2021.03.16"

import rhinoscriptsyntax as rs
import subprocess
import os
triangulation = [(~1,~8,~0),(~7,3,8),(~2,~6,7),(~5,2,6),(~3,~4,5),(0,1,4)]

curve = curve.replace(',','').replace('[','').replace(']','')

if ghdoc.Path:
    direc = os.path.dirname(ghdoc.Path)

    
Path = direc + "\\" + file


args = [curve]
if Run:
    
    comm = subprocess.Popen(['C:\Python39\python.exe', Path] + args, stdout=subprocess.PIPE, stderr=subprocess.STDOUT)
    stdout = comm.communicate()
    
    stdout=stdout[0]
    
    if stdout[:9] == 'Traceback':
        print stdout
    else:
        data=eval(stdout)
    

    comm.stdout.close()
    comm.wait()
# ---------- end python_2 ----------
panel = Panel(python.data)
panel_2 = Panel(python.out)
panel_3 = Panel(python_2.out)
panel_4 = Panel(python_2.data)
abstract_points_to_rhino3dpoints = GhPythonScript(mapCurveDict=sort_map_curves.mapCurveDict, abstractPointsList=python_2.data)  # -> out, pairedPushPoints3D
# ---------- abstract_points_to_rhino3dpoints: Python ----------
"""Provides a scripting component.
    Inputs:
        mapCurveDict: A dictionary mapping flipper edges to rhino curves
        abstractPointsList: A list of numbered intersections with each map edge, 
            as processed by flipper
    Output:
        pairedPushPoints3D: A list of pairs of 3d points corresponding to the 
            intersection points indicated in the abstractPointsList"""

__author__ = "Shoon"
__version__ = "2021.03.26"

import rhinoscriptsyntax as rs

# Count the number of intersection points on each edge.
# This will tell us how we should space them out.
pointsPerEdge = {}
for pair in abstractPointsList:
    for intersection in pair:
        pointsPerEdge[intersection[0]] += 1
        
# Place the points on each curve, limited to the parameter range [0.1, 0.9].
# Staying away from where we meet the puncture curves is a little safer.
pairedPushPoints3D = []
for pair in abstractPointsList:
    firstParam = (0.8 * (pair[0][1]/pointsPerEdge[pair[0]])) + 0.1
    first = rs.EvaluateCurve(mapCurveDict[pair[0][0]], firstParam)  
    secondParam = (0.8 * (pair[1][1]/pointsPerEdge[pair[1]])) + 0.1
    second = rs.EvaluateCurve(mapCurveDict[pair[1][0]], secondParam)
    pairedPushPoints3D.append((first, second))
# ---------- end abstract_points_to_rhino3dpoints ----------
sort_points_by_push_order = GhPythonScript(
    curve=s20_and_master_curve_cluster.master_curve_smooth_2,
    pairedPointsList=abstract_points_to_rhino3dpoints.pairedPushPoints3D)  # -> out, sortedPointPairs
# ---------- sort_points_by_push_order: Python ----------
"""Provides a scripting component.
    Inputs:
        pairedPointsList: Collection of pairs of Rhino points
        curve: Master curve to put points on (for grabbing params)
            Must be parametrized on [0,1]
    Output:
        a: The list of pairs of 3dRhinoPoints sorted in the order they should be
            applied to the master curve."""

__author__ = "Shoon"
__version__ = "2021.02.26"

import rhinoscriptsyntax as rs


# Whole script is inefficient - rewrite later maybe

def get_param_dist(pointA, pointB):
    pointA = rs.coerce3dpoint(pointPair[0])
    pointB = rs.coerce3dpoint(pointPair[1])
    paramA = rs.CurveClosestPoint(curve, pointA)
    paramB = rs.CurveClosestPoint(curve, pointB)
    a = min(paramA, paramB)
    b = max(paramA, paramB)
    
    return(min(b - a, 1 - (b - a)))

sortedPointPairs = sorted(pairedPointsList, key = get_param_dist, reverse = True)
# ---------- end sort_points_by_push_order ----------
fully_push_curve = GhPythonScript(
    curve=s20_and_master_curve_cluster.master_curve_smooth_2,
    brep=s20_and_master_curve_cluster.geo,
    pointPairs=sort_points_by_push_order.sortedPointPairs)  # -> out, pushedCurveFragments
# ---------- fully_push_curve: Python ----------
"""Provides a scripting component.
    Inputs:
        curve: Initial Master Curve, parametrized to [0,1]
        pointPairs: A list of pairs of points to use for pushing, in order
    Output:
        a: The a output variable"""

__author__ = "Shoon"
__version__ = "2021.02.26"

import rhinoscriptsyntax as rs
import Grasshopper as gh
import os

# Coerce inputs
curve = rs.coercecurve(curve)
brep = rs.coercebrep(brep)

# Set cluster path
par = os.path.abspath(os.path.join(os.path.dirname(ghenv.Component.OnPingDocument().FilePath)))
clusterFilePath = os.path.join(par, "PushCurvePart.ghcluster")


def iterate_push (doc, curve, dStart, dEnd):    
    cluster = gh.Kernel.Special.GH_Cluster()
    cluster.CreateFromFilePath(clusterFilePath)
    cluster.Params.Input[0].AddVolatileData(gh.Kernel.Data.GH_Path(0), 0, curve)
    cluster.Params.Input[1].AddVolatileData(gh.Kernel.Data.GH_Path(0), 0, dStart)
    cluster.Params.Input[2].AddVolatileData(gh.Kernel.Data.GH_Path(0), 0, dEnd)
    cluster.Params.Input[3].AddVolatileData(gh.Kernel.Data.GH_Path(0), 0, brep)
    a = gh.Kernel.Parameters.Param_Curve()
    b = gh.Kernel.Parameters.Param_Curve()
    
    cluster.Params.RegisterOutputParam(a)
    cluster.Params.RegisterOutputParam(b)
    doc.Enabled = True
    doc.AddObject(cluster, True, 0)
    pushedFrag = cluster.Params.Output[0].VolatileData
    newMasterCurve = cluster.Params.Output[0].VolatileData
    doc.Enabled = False
    doc.RemoveObject(cluster, False)
    return(a, b)

    
def main():
    # Get doc and set output vars
    doc = gh.Kernel.GH_Document()
    pushedCurveFragments = []
    masterCurve = curve
    
    for pair in [[0.5,0.6], [0.6,0.7]]:
        pair[0] = rs.EvaluateCurve(masterCurve, pair[0])
        pair[1] = rs.EvaluateCurve(masterCurve, pair[1])
        # Map 3-D points to parameters
        (pair0, pair1) = (rs.coerce3dpoint(pair[0]), rs.coerce3dpoint(pair[1]))
        (pair0, pair1) = (rs.CurveClosestPoint(masterCurve, pair0), rs.CurveClosestPoint(masterCurve, pair1))
        # Figure out how to do the start and end of the domains, espec if they go through 1
        # The logic for this might already be in the cluster, but I'm not sure.
        
        # push and get return values
        print(masterCurve, pair)
        (newFrag, masterCurve) = iterate_push(doc, masterCurve, pair[0], pair[1])
        pushedCurveFragments.append(newFrag)
        
    # destroy doc
    doc.Dispose()
    doc = None
        
    return(pushedCurveFragments)
    
pushedCurveFragments = main()
# ---------- end fully_push_curve ----------
partly_pushed_full_curve = PartlyPushedFullCurve(
    curve=s20_and_master_curve_cluster.master_curve_smooth_2,
    domain_start=Slider(0.593, range=0..1),
    domain_end=Slider(0.603, range=0..1),
    brep=s20_and_master_curve_cluster.geo)  # -> curve_4, curve_3

# ==== cluster PartlyPushedFullCurve
curve = ClusterInput()
number = Number(0.0001)
number_2 = Number(0.01)
curve_2 = Curve(reparameterize(curve))
brep = ClusterInput()
domain_start = ClusterInput()
domain_end = ClusterInput()
construct_domain = ConstructDomain(DomainStart=domain_start, DomainEnd=domain_end)
sub_curve = SubCurve(BaseCurve=reparameterize(curve_2), Domain=construct_domain)
number_3 = Number(-30)
number_4 = Number(500)
curve_contraction_cluster = CurveContractionCluster(brep=brep, curve=sub_curve, steps=number_4, rightwards=number_3)  # -> curve_3, point
ghpython_script = GhPythonScript(
    start=domain_start,
    end=domain_end,
    step=number,
    separation=number_2,
    baseCurve=curve_2,
    pushedPoints=curve_contraction_cluster.point)  # -> out, points; inputs pushedPoints: list
# ---------- ghpython_script: Python ----------
__author__ = "Shoon"
__version__ = "2021.01.27"

import rhinoscriptsyntax as rs

points = []

def frange(a,b,s):
    x = float(a)
    while x < b:
        yield x
        x+=s


[points.append(rs.EvaluateCurve(baseCurve,i)) for i in frange(max(0,end+separation-1),max(0,end+separation-1,start-separation),step)]

points += rs.coerce3dpointlist(pushedPoints)

[points.append(rs.EvaluateCurve(baseCurve,i)) for i in frange(min(end+separation,1,1+start-separation),min(1+start-separation,1),step)]
# ---------- end ghpython_script ----------
interpolate_t = InterpolateT(Vertices=ghpython_script.points, TangentStart=Vector(0, 0, 0), TangentEnd=Vector(0, 0, 0), KnotStyle=1)  # -> Curve, Length, Domain
curve_3 = ClusterOutput(interpolate_t.Curve)
curve_4 = ClusterOutput(curve_contraction_cluster.curve_3)

# ==== cluster S20AndMasterCurveCluster
raw_map_curves = Curve([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])
wide = Slider(0.341, range=-10..10)
taper = Slider(0.047, range=-0.2..0.2)
number = Number(1)
genus_2_surface = Genus2Surface(wide=wide, long=Slider(2.73, range=0..5), round=Slider(5.379, range=0..10), thick=Slider(9, range=0..10), taper=taper)  # -> L, geo_2
cluster = Cluster(curve=raw_map_curves, brep=genus_2_surface.geo_2)
map_curves_on_polysurface = Curve(reparameterize(cluster))
offset_curve_cluster = CurveContractionCluster(brep=genus_2_surface.geo_2, curve=map_curves_on_polysurface, steps=1000, rightwards=number)  # -> curve_3, point
offset_curves_almost_on_polysurface = Curve(reparameterize(offset_curve_cluster.curve_3))
opacity = Slider(128, range=0..255)
color = Slider(16, range=0..19)
raw_puncture_curves = Curve([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])
mypreview = RGBPreview(G=genus_2_surface.geo_2, A=opacity, N=color)
cluster_2 = Cluster(curve=raw_puncture_curves, brep=genus_2_surface.geo_2)
puncture_curves_on_polysurface = Curve(reparameterize(cluster_2))
merge = Merge(Data1=map_curves_on_polysurface, Data2=offset_curves_almost_on_polysurface, Data3=puncture_curves_on_polysurface)
join_curves = JoinCurves(Curves=merge, Preserve=False)
curve_failed_fr_some_reason = Curve(join_curves)
master_curve_raw = Curve(reparameterize(<curve referenced from the Rhino model>))
fit_curve_smooth = FitCurveSmooth(Curve=master_curve_raw, FitTolerance=0.001, AngleTolerance=1)
master_curve_smooth = Curve(fit_curve_smooth)
offset_curves_almost_on_polysurface_2 = ClusterOutput(offset_curves_almost_on_polysurface)
puncture_curves_on_polysurface_2 = ClusterOutput(puncture_curves_on_polysurface)
map_curves_on_polysurface_2 = ClusterOutput(map_curves_on_polysurface)
master_curve_smooth_2 = ClusterOutput(master_curve_smooth)
geo = ClusterOutput(genus_2_surface.geo_2)

# ==== cluster CurveContractionCluster
steps = ClusterInput()
brep = ClusterInput()
rightwards = ClusterInput()
curve = ClusterInput()
curve_2 = Curve(curve)
range = Range(Domain=Domain(0, 1), Steps=steps)
evaluate_curve = EvaluateCurve(Curve=reparameterize(curve_2), Parameter=range)  # -> Point, Tangent, Angle
brep_2 = Brep(brep)
brep_closest_point = BrepClosestPoint(Point=evaluate_curve.Point, Brep=brep_2)  # -> Point, Normal, Distance
script_1_tbd = GhPythonScript(x=evaluate_curve.Point, y=evaluate_curve.Tangent, z=brep_closest_point.Normal, Rightwards=rightwards)  # -> out, shiftedPoints
# ---------- script_1_tbd: Python ----------
"""Provides a scripting component.
    Inputs:
        x: Points along Curve
        y: Vectors tangent to curve at each point
        z: Vectors normal to surface at each point
        inwards: 1 if you want to shift curve inwards, -1 if outwards
    Output:
        a: The a output variable"""

__author__ = "Shoon"
__version__ = "2020.11.04"

import rhinoscriptsyntax as rs

epsilon = 0.01

print(x)
print(y)
print(z)

# Compute the cross product of the above two vectors at each point
crosses = Rightwards * rs.VectorCrossProduct(z,y)

# Displace points along said cross product by some distance
shiftedPoints = rs.VectorAdd(x,epsilon*crosses)

# Copy points up by epsilon and down by epsilon to form a ribbon


# Take the intersection of the ribbon with the surface and draw it
# ---------- end script_1_tbd ----------
brep_closest_point_2 = BrepClosestPoint(Point=script_1_tbd.shiftedPoints, Brep=brep_2)  # -> Point, Normal, Distance
point = ClusterOutput(brep_closest_point_2.Point)
interpolate = Interpolate(Vertices=brep_closest_point_2.Point, Degree=3, Periodic=False, KnotStyle=1)  # -> Curve, Length, Domain
curve_3 = ClusterOutput(interpolate.Curve)

# ==== cluster RGBPreview: Custom Preview clustered with RGB module with preset colors
N = ClusterInput()
python = GhPythonScript(N=N)  # -> out, R, G, B
# ---------- python: Python ----------
__author__ = "will"
__version__ = "2020.07.20"

import rhinoscriptsyntax as rs

colors=[(0,0,0),(255,255,255),(115,115,115),(255,0,0),(0,255,0),(0,0,255),(255,255,0),(255,0,255),(0,255,255),(0,162,255),(252,124,21),(124,51,202),(23,151,59),(255,80,90),(255,80,226),(32,214,255),(0,92,0),(0,0,120),(112,255,49),(138,78,0)]

N=int(N)
R = colors[N][0]
G = colors[N][1]
B = colors[N][2]
# ---------- end python ----------
A = ClusterInput()
G = ClusterInput()
rgb = ColourRGB(Alpha=A, Red=python.R, Green=python.G, Blue=python.B)
preview = CustomPreview(Geometry=G, Material=rgb)

# ==== cluster Genus2Surface
number_slider = Slider(4, range=0..16)
wide = ClusterInput()
multiplication = Multiplication(A=number_slider, B=2)
long = ClusterInput()
round = ClusterInput()
thick = ClusterInput()
subtraction = Subtraction(A=number_slider, B=1)
taper = ClusterInput()

# ----
# wonky tori
number_slider_2 = Slider(16.8, range=0..20)
addition = Addition(A=number_slider_2, Wide=wide)
dom = ConstructDomain(DomainStart=0, DomainEnd=1)
ellipse = Ellipse(Plane=PlaneXY(0, 0, 0), Radius1=number_slider_2, Radius2=addition)  # -> reparameterize(Ellipse), Focus1, Focus2
range = Range(Domain=dom, Steps=multiplication)
num = Number(range)
curvature = Curvature(Curve=ellipse.Ellipse, Parameter=num)  # -> P, unitize(K), C
python = GhPythonScript(x=num, long=long, round=round, thick=thick)  # -> out, a, b, c
# ---------- python: Python ----------
__author__ = "will"
__version__ = "2020.07.08"

import rhinoscriptsyntax as rs

a = ((x-.5)*long)**6

b = ((x-.5)*round)**2 + thick

c = a + thick
# ---------- end python ----------
rev = Reverse(Vector=curvature.K)
multiplication_2 = Multiplication(A=rev, B=python.a)
number_slider_3 = Slider(12, range=0..30)
addition_2 = Addition(A=multiplication_2, B=curvature.P)
Z = UnitZ(Factor=1)
dom_2 = ConstructDomain(DomainStart=0, DomainEnd=1)
pl = ConstructPlane(Origin=addition_2, XAxis=Z, YAxis=curvature.K)
range_2 = Range(Domain=dom_2, Steps=number_slider_3)
ellipse_2 = Ellipse(Plane=pl, Radius1=python.b, Radius2=python.c)  # -> reparameterize(Ellipse), Focus1, Focus2
split = SplitList(List=range_2, Index=number_slider_3)  # -> graft(ListA), ListB
item = ListItem(List=addition_2, Index=0, Wrap=True)
eval = EvaluateCurve(Curve=ellipse_2.Ellipse, Parameter=split.ListA)  # -> Point, Tangent, Angle
split_2 = SplitList(List=ellipse_2.Ellipse, Index=1)  # -> ListA, ListB
yz = YZPlane(Origin=Point(0, 0, 0))
intcrv = Interpolate(Vertices=eval.Point, Degree=3, Periodic=True, KnotStyle=1)  # -> flatten(Curve), Length, Domain
pl_origin = PlaneOrigin(Base=yz, Origin=item)
number_slider_4 = Slider(0.3, range=0..1)
addition_3 = Addition(A=number_slider_4, Taper=taper)

shift = ShiftList(List=split_2.ListB, Shift=subtraction, Wrap=True)

netsurf = NetworkSurface(CurvesU=shift, CurvesV=intcrv.Curve, Continuity=2)
mirror = Mirror(Geometry=netsurf, Plane=pl_origin)  # -> Geometry, Transform
join = BrepJoin(Breps=[mirror.Geometry, netsurf])  # -> Breps, Closed
taper_2 = Taper(
    Geometry=join.Breps,
    Axis=Line((-30, 0, 0), (80, 0, 0)),
    Start=number_slider_4,
    End=addition_3,
    Flat=False,
    Infinite=False,
    Rigid=False)
item_2 = ListItem(List=taper_2, Index=1, Wrap=True)
item_3 = ListItem(List=taper_2, Index=0, Wrap=True)

# ----
# Waist
hilonums = HighestLowestNumbers(Numbers=python.c)  # -> Highest, Lowest
number_slider_5 = Slider(7.305, range=0..10)
number_slider_6 = Slider(3.563, range=0..4)
number_slider_7 = Slider(2.366, range=0..4)
multiplication_3 = Multiplication(A=hilonums.Highest, B=2)
neg = Negative(Value=number_slider_7)
neg_2 = Negative(Value=number_slider_6)
neg_3 = Negative(Value=number_slider_5)
division = Division(A=hilonums.Highest, B=[neg_3, neg_2, neg])
division_2 = Division(A=hilonums.Highest, B=[number_slider_7, number_slider_6, number_slider_5])
X = UnitX(Factor=division_2)
X_2 = UnitX(Factor=division)
bbox = BoundingBox(Content=taper_2, Plane=PlaneXY(0, 0, 0), UnionBox=True)  # -> Box, Box_2
move = Move(Geometry=pl_origin, Motion=X)  # -> Geometry, Transform
move_2 = Move(Geometry=pl_origin, Motion=X_2)  # -> Geometry, Transform
box_corners = BoxCorners(Box=bbox.Box)  # -> CornerA, CornerB, CornerC, CornerD, CornerE, CornerF, CornerG, CornerH
pdecon = Deconstruct(Point=box_corners.CornerA)  # -> XComponent, YComponent, ZComponent
neg_4 = Negative(Value=pdecon.YComponent)
dom_3 = ConstructDomain(DomainStart=neg_4, DomainEnd=pdecon.YComponent)
planesrf = PlaneSurface(Plane=move_2.Geometry, XSize=dom_3, YSize=dom_3)
planesrf_2 = PlaneSurface(Plane=move.Geometry, XSize=dom_3, YSize=dom_3)
bbx = BrepBrep(BrepA=planesrf, BrepB=item_2)  # -> flatten(Curves), Points
bbx_2 = BrepBrep(BrepA=planesrf_2, BrepB=item_3)  # -> flatten(Curves), Points
crv = Curve([bbx_2.Curves, bbx.Curves])
loft = Loft(Curves=flatten(crv), Options={Adjust=True, Closed=False, LoftEnds=0, LoftSimp=0, LoftType=1, Rebuild=10, Refit=0.01})

# ----
# Trimmed wonky tori
item_4 = ListItem(List=planesrf, Index=-1, Wrap=True)
item_5 = ListItem(List=planesrf_2, Index=0, Wrap=True)
X_3 = UnitX(Factor=multiplication_3)
neg_5 = Negative(Value=X_3)
extr = Extrude(Base=item_5, Direction=neg_5)
extr_2 = Extrude(Base=item_4, Direction=X_3)
trim = TrimSolid(Shape=item_2, Cutters=extr_2)
trim_2 = TrimSolid(Shape=item_3, Cutters=extr)

L = ClusterOutput(loft)
join_2 = BrepJoin(Breps=flatten([trim, loft, trim_2]))  # -> Breps, Closed
geo = Geometry(join_2.Breps)
geo_2 = ClusterOutput(geo)

# ==== cluster Cluster
integer = Integer(500)
curve = ClusterInput()
range = Range(Domain=Domain(0, 1), Steps=integer)
evaluate_curve = EvaluateCurve(Curve=reparameterize(graft(curve)), Parameter=range)  # -> Point, Tangent, Angle
brep = ClusterInput()
brep_closest_point = BrepClosestPoint(Point=evaluate_curve.Point, Brep=brep)  # -> Point, Normal, Distance
interpolate = Interpolate(Vertices=brep_closest_point.Point, Degree=3, Periodic=False, KnotStyle=1)  # -> Curve, Length, Domain
curve_2 = ClusterOutput(interpolate.Curve)
